# Dynamo graph Dublin_TechHub_Native_BIM.dyn (Dynamo 3.4.0.0)
# author: AegisBIM Lead Engineer
# Generates 100% Real Native Revit Walls, Slabs, Levels, Ducts and Trays

python_script_native_revit_api = Python()  # "Python Script - Native Revit API (CPython3)"; CPython3
# ---------- python_script_native_revit_api.python (129 lines) ----------
import clr
clr.AddReference('RevitServices')
import RevitServices
from RevitServices.Persistence import DocumentManager
from RevitServices.Transactions import TransactionManager

clr.AddReference('RevitAPI')
from Autodesk.Revit.DB import *
from Autodesk.Revit.DB.Mechanical import *
from Autodesk.Revit.DB.Electrical import *

doc = DocumentManager.Instance.CurrentDBDocument

TransactionManager.Instance.EnsureInTransaction(doc)

MM_TO_FT = 1.0 / 304.8
floor_height = 3800.0 * MM_TO_FT

# 1. Get Default Wall & Floor Types
wall_type = FilteredElementCollector(doc).OfClass(WallType).FirstElement()
floor_type = FilteredElementCollector(doc).OfClass(FloorType).FirstElement()

# 2. Ensure 7 Levels
levels = []
for i in range(7):
    elev = i * floor_height
    lvl = None
    for l in FilteredElementCollector(doc).OfClass(Level):
        if abs(l.Elevation - elev) < 0.1:
            lvl = l
            break
    if not lvl:
        lvl = Level.Create(doc, elev)
        lvl.Name = f'Level {i} - Enterprise'
    levels.append(lvl)

created_elements = []
hw = (34000.0 * MM_TO_FT) / 2.0
hd = (24000.0 * MM_TO_FT) / 2.0

# 3. Create Real Walls & Floors on All 7 Levels
for lvl_idx, lvl in enumerate(levels):
    p0 = XYZ(-hw, -hd, 0)
    p1 = XYZ(hw, -hd, 0)
    p2 = XYZ(hw, hd, 0)
    p3 = XYZ(-hw, hd, 0)
    
    # Real Floor Slab
    if floor_type:
        try:
            loop = CurveLoop()
            loop.Append(Line.CreateBound(p0, p1))
            loop.Append(Line.CreateBound(p1, p2))
            loop.Append(Line.CreateBound(p2, p3))
            loop.Append(Line.CreateBound(p3, p0))
            fl = Floor.Create(doc, [loop], floor_type.Id, lvl.Id)
            created_elements.append(fl)
        except Exception:
            pass
    
    # Real Perimeter Exterior Walls
    if wall_type:
        try:
            w1 = Wall.Create(doc, Line.CreateBound(p0, p1), wall_type.Id, lvl.Id, floor_height, 0, False, False)
            w2 = Wall.Create(doc, Line.CreateBound(p1, p2), wall_type.Id, lvl.Id, floor_height, 0, False, False)
            w3 = Wall.Create(doc, Line.CreateBound(p2, p3), wall_type.Id, lvl.Id, floor_height, 0, False, False)
            w4 = Wall.Create(doc, Line.CreateBound(p3, p0), wall_type.Id, lvl.Id, floor_height, 0, False, False)
            created_elements.extend([w1, w2, w3, w4])
        except Exception:
            pass
    
    # Real Central Elevator / Core Walls
    if wall_type:
        try:
            c0 = XYZ(-6000 * MM_TO_FT, 3000 * MM_TO_FT, 0)
            c1 = XYZ(6000 * MM_TO_FT, 3000 * MM_TO_FT, 0)
            c2 = XYZ(-6000 * MM_TO_FT, -3000 * MM_TO_FT, 0)
            c3 = XYZ(6000 * MM_TO_FT, -3000 * MM_TO_FT, 0)
            cw1 = Wall.Create(doc, Line.CreateBound(c0, c1), wall_type.Id, lvl.Id, floor_height, 0, False, True)
            cw2 = Wall.Create(doc, Line.CreateBound(c2, c3), wall_type.Id, lvl.Id, floor_height, 0, False, True)
            created_elements.extend([cw1, cw2])
        except Exception:
            pass
    
    # Level 3 Comms Room & Boardroom Interior Walls
    if lvl_idx in [3, 4] and wall_type:
        try:
            cr0 = XYZ(-13000 * MM_TO_FT, -10000 * MM_TO_FT, 0)
            cr1 = XYZ(-5000 * MM_TO_FT, -10000 * MM_TO_FT, 0)
            cr2 = XYZ(-5000 * MM_TO_FT, -5000 * MM_TO_FT, 0)
            rw1 = Wall.Create(doc, Line.CreateBound(cr0, cr1), wall_type.Id, lvl.Id, floor_height - (600 * MM_TO_FT), 0, False, False)
            rw2 = Wall.Create(doc, Line.CreateBound(cr1, cr2), wall_type.Id, lvl.Id, floor_height - (600 * MM_TO_FT), 0, False, False)
            created_elements.extend([rw1, rw2])
        except Exception:
            pass

# 4. Create Real MEP Ducts on Level 3
duct_type = FilteredElementCollector(doc).OfClass(DuctType).FirstElement()
mep_sys = None
for s in FilteredElementCollector(doc).OfClass(MEPSystemType):
    if s.SystemClassification == MEPSystemClassification.SupplyAir:
        mep_sys = s
        break

if duct_type and mep_sys and len(levels) > 3:
    try:
        l3 = levels[3]
        d_start = XYZ(-13000 * MM_TO_FT, 0, l3.Elevation + (2950 * MM_TO_FT))
        d_end = XYZ(13000 * MM_TO_FT, 0, l3.Elevation + (2950 * MM_TO_FT))
        duct = Duct.Create(doc, mep_sys.Id, duct_type.Id, l3.Id, d_start, d_end)
        created_elements.append(duct)
    except Exception:
        pass

# 5. Create Real Cable Trays on Level 3
tray_type = FilteredElementCollector(doc).OfClass(CableTrayType).FirstElement()
if tray_type and len(levels) > 3:
    try:
        l3 = levels[3]
        t_start = XYZ(-14000 * MM_TO_FT, -4000 * MM_TO_FT, l3.Elevation + (2650 * MM_TO_FT))
        t_end = XYZ(14000 * MM_TO_FT, -4000 * MM_TO_FT, l3.Elevation + (2650 * MM_TO_FT))
        tray = CableTray.Create(doc, tray_type.Id, t_start, t_end, l3.Id)
        created_elements.append(tray)
    except Exception:
        pass

TransactionManager.Instance.TransactionTaskDone()

OUT = f'Successfully created {len(created_elements)} 100% NATIVE Revit Walls, Floors, Ducts & Trays!'
# ----------------------------------------
